# Grasshopper definition 44100.gh (Grasshopper 0.9.10)

number_per_line = Slider(210, range=10..210)
panel = Panel("C:\Users\adleberg\Downloads\acdc.txt")
panel_2 = Panel("C:\Users\adleberg\Downloads\440.txt")
panel_3 = Panel("C:\Users\adleberg\Downloads\44100.txt")
vertical_slider = Slider(5, range=1..5)
multiplication = Multiplication(A=number_per_line, B=number_per_line)
file = ReadFile(Path="C:\Users\adleberg\Downloads\miles.txt", Lines=True)
series = Series(Start=0, Step=1, Count=number_per_line)
division = Division(A="1", B=number_per_line)
series_2 = Series(Start=0, Step=1, Count=multiplication)
series_3 = Series(Start=0, Step=division, Count=multiplication)
dup = DuplicateData(Data=series, Number=number_per_line, Order=True)
item = ListItem(List=file, Index=series_2, Wrap=False)
multiplication_2 = Multiplication(A=vertical_slider, B=item)
round = Round(Number=series_3)  # -> Nearest, Floor, Ceiling
pt = PointXYZ(XComponent=dup, YComponent=round.Floor, ZComponent=multiplication_2, System=PlaneXY(0, 0, 0))
srfgrid = SurfaceFromPoints(Points=pt, UCount=number_per_line, Interpolate=False)
pline = PolyLine(Vertices=pt, Closed=False)
loft = Loft(Options={Adjust=False, Closed=False, Rebuild=10, Refit=0.01, LoftType=0, LoftEnds=0, LoftSimp=0})
rgb = ColourRGB(Alpha=255, Red=0, Green=0, Blue=0)
intcrv_t = InterpolateT(Degree=3, TangentStart=Vector(0, 0, 0), TangentEnd=Vector(0, 0, 0), KnotStyle=1)  # -> Curve, Length, Domain; disabled
loft_2 = Loft(Options={Adjust=False, Closed=False, Rebuild=10, Refit=0.01, LoftType=0, LoftEnds=0, LoftSimp=0})
